# Requirement set Stop_and_Wait (R2024b)

## 1 [Sender] Clarifying requirements of Sender part

### 1.1 [SND-1] Packet should be create and send when a new data arrived
The input data should be a uint8 form of a character and and a boolean which acts as an event which is used to verify if the input data is valid. If the event was active, the model should create an uint16 packet which contains data and its header. Then, the packet should send to other model.

### 1.2 [SND-2] Packet should have a tag and a header
The packet created should contain 3 parts:
1. Original data (bit 0 to 7)
2. A tag to prevent resending a packet which has sent (bit 8)
3. A header so the receiver should check the correctness of data

### 1.3 [SND-3] Header should create using CRC
Header of a packet should use cyclic redundancy check (CRC) method. Note that the tag should concatenate with the input data.

### 1.4 [SND-4] A state should be to wait for ACK
After sending the packet, there should be a state so we wait until an acknowledgment (ACK) receive. If no ACK received after a time, we can resend the packet.

### 1.5 [SND-5] Received ACK should check its correctness
There should be an uint8 acknowledgement (ACK). The ACK declares whether the data is sent successfully or not. The Ack should check and if it contains the desired value, we can get ready to send the next data. Note that if the ACK was correct, we should update the next ack value and the tag.

### 1.6 [SND-6] Timeout mechamism should be considered
If no ACK received after 4 seconds, timeout should enable and resend the previous data again.

### 1.7 [SND-7] Reseting sender should be considered
After sending a stream of data, the sender part should reset to its defaults.

### 1.8 [SND-8] ACK incrementation should check
After ACK successfully received, it should increment for next check. This data is an uint8 value, so if it reach 15, it should set to 0 for the next value.

## 2 [Receiver] Clarifying requirements of receiver part

### 2.1 [RCV-1] Packet should check its correctness
There should be an uint16 input for packet received. Also, there should be an event for that packet indicating the presence of new packet. Then, it should check its correctness by checking the header. If the packet was not corrupted, the model should update its checking parameters like sending ACK value and tag. Also, the model should send an acknowledgement (ACK) to sender indicating that the packet has arrived successfully.

### 2.2 [RCV-2] A header should append to ACK
To check the correctness of the ACK generated after receiving tha packet, there should append a header to the data of the ACK.

### 2.3 [RCV-3] ACK header should use CRC
Header of a ACK should use cyclic redundancy check (CRC) method.

### 2.4 [RCV-4] Reseting receiver should be considered
After receiving a stream of packets, the receiver part should reset to its defaults.